# Grasshopper definition Kohonen_example_001_colour.gh (Grasshopper 0.9.76)
# plug-ins: KohonenMapper

# ---- group: 4 inputs
random = Random(Range=Domain(0, 1), Number=Slider(15, range=0..100), Seed=Slider(4, range=0..10))

# ---- group: Feature dimension (=3)
number_slider = Slider(3, range=0..10)

# ----
number_slider_2 = Slider(20, range=0..100)
number_slider_3 = Slider(2, range=0..10)
number_slider_4 = Slider(30, range=0..100)
c_script = CSharpScript(x=random, y=number_slider)  # -> A; inputs x: list of Double, y: Int32
# ---------- c_script: C# ----------
    var tree = new DataTree<double>();
    GH_Path path;
    int legge = x.Count / y;
    int counter = 0;
    
    for (int i = 0; i < legge; i++)
    {
      path = new GH_Path(i);
      for (int j = 0; j < y; j++)
      {
        tree.Add(x[counter], path);
        counter++;
      }
    }

    A = tree;
# ---------- end c_script ----------

# ---- group: Toggle to False
toggle = BooleanToggle(False)

# ----
panel = Panel(c_script)
cluster = Cluster(num=number_slider_4, num_2=number_slider_2, num_3=number_slider_3)

# ---- group: ENABLE!
timer = Timer(TimerInterval=20, Target=kohonen_map)  # disabled

# ----
kohonen_map = KohonenMap(
    Reset=toggle,
    XMap=number_slider_4,
    YMap=number_slider_2,
    Space=number_slider_3,
    Inputs=c_script,
    WinLearn=0.95,
    Learn=0.9,
    WinLearnDecay=Slider(0.999, range=0..1),
    LearnDecay=0.9975,
    NeighDecay=0.99,
    NeighRad=0.5,
    Seed=Slider(3, range=0..10))  # -> Coverged, Counter, Locations, Synaptics, Neigh, InputLocations

# ---- group: If you really want
voronoi = Voronoi(Points=kohonen_map.InputLocations, Boundary=cluster, Plane=cluster, BruteForceOverride=False)  # disabled

# ----
preview = CustomPreview(Geometry=voronoi, Shader=ColourSwatch(SwatchColor=RGB(255, 255, 255)))

# ---- group: Display map
item = ListItem(List=kohonen_map.Synaptics, Index=0, Wrap=True)  # -> Item, Item1, Item2
frgb = ColourRGBF(Alpha=1, Red=item.Item, Green=item.Item1, Blue=item.Item2)
box = CenterBox(Base=kohonen_map.Locations, X=1, Y=1, Z=1)
preview_2 = CustomPreview(Geometry=box, Shader=frgb)

# ----
line = LineSDL(Start=kohonen_map.InputLocations, Direction=Vector(0, 0, 1), Length=Slider(9, range=0..100))

# ---- group: Display input location on map
item_2 = ListItem(List=c_script, Index=0, Wrap=True)  # -> Item, Item1, Item2
box_2 = CenterBox(Base=graft(kohonen_map.InputLocations), X=1, Y=1, Z=1)
frgb_2 = ColourRGBF(Alpha=1, Red=item_2.Item, Green=item_2.Item1, Blue=item_2.Item2)

# ----
move = Move(Geometry=box_2, Motion=Vector(0, 0, 10))  # -> Geometry, Transform

# ---- group: Display input location on map (continued)
preview_3 = CustomPreview(Geometry=move.Geometry, Shader=frgb_2)

# ==== cluster Cluster
num = ClusterInput()
num_2 = ClusterInput()
num_3 = ClusterInput()
num_4 = Number(num)
num_5 = Number(num_2)
num_6 = Number(num_3)
number_slider = Slider(1, range=0..1)
subtraction = Subtraction(A=num_4, B=number_slider)
subtraction_2 = Subtraction(A=num_5, B=number_slider)
multiplication = Multiplication(A=subtraction_2, B=num_6)
multiplication_2 = Multiplication(A=subtraction, B=num_6)
dom = ConstructDomain(DomainStart=0, DomainEnd=multiplication)
dom_2 = ConstructDomain(DomainStart=0, DomainEnd=multiplication_2)
planesrf = PlaneSurface(Plane=PlaneXY(0, 0, 0), XSize=dom_2, YSize=dom)
P = ClusterOutput(planesrf)
