# Grasshopper definition Kohonen_example_003.gh (Grasshopper 0.9.76)
# plug-ins: KohonenMapper

# ---- group: 4 dimensions
number_slider = Slider(5, range=0..10)

# ----
random = Random(Range=Domain(0, 1), Number=Slider(35, range=0..100), Seed=Slider(3, range=0..10))

# ---- group: Builds a data-tree of the inputs' feature vector
c_script = CSharpScript(x=random, y=number_slider)  # -> A; inputs x: list of Double, y: Int32
# ---------- c_script: C# ----------
    var tree = new DataTree<double>();
    GH_Path path;
    int legge = x.Count / y;
    int counter = 0;
    
    for (int i = 0; i < legge; i++)
    {
      path = new GH_Path(i);
      for (int j = 0; j < y; j++)
      {
        tree.Add(x[counter], path);
        counter++;
      }
    }

    A = tree;
# ---------- end c_script ----------

# ---- group: ENABLE!
timer = Timer(TimerInterval=20, Target=kohonen_map)  # disabled

# ---- group: Check datastructure
panel = Panel(c_script)

# ---- group: Location for displaying inputs
item = ListItem(List=c_script, Index=0, Wrap=True)
lng = ListLength(List=flatten(item))
series = Series(Start=0, Step="2.0", Count=lng)
pt = Point(Point(0.8259923995, -5.954375238, 0))
X = UnitX(Factor=series)
xy = XYPlane(Origin=pt)
move = Move(Geometry=xy, Motion=graft(X))  # -> Geometry, Transform

# ----
kohonen_map = KohonenMap(
    Reset=Toggle(False),
    XMap=Slider(25, range=0..100),
    YMap=Slider(17, range=0..100),
    Space=Slider(2, range=0..10),
    Inputs=c_script,
    WinLearn="0.98",
    Learn="0.95",
    WinLearnDecay=0.998,
    LearnDecay=0.9975,
    NeighDecay=0.99,
    NeighRad=Slider(0.5, range=0..1),
    Seed=Slider(21, range=0..100))  # -> Coverged, Counter, Locations, Synaptics, Neigh, InputLocations
item_2 = ListItem(List=c_script, Index=0, Wrap=True)  # -> Item, Item1, Item2, Item3
panel_2 = Panel("""0
0""")
path = ConstructPath(Indices=panel_2)
multiplication = Multiplication(A=item_2.Item3, B="256")
branch = TreeBranch(Tree=kohonen_map.Synaptics, Path=path, MaintainPaths=True)
# (display output)
lng_2 = ListLength(List=flatten(branch))

# ---- group: Display 'winning' node location
point = Point(kohonen_map.InputLocations)
circle = Circle(Plane=point, Radius=1)
Z = UnitZ(Factor="2.0")
Z_2 = UnitZ(Factor="-1.0")
colour_swatch = ColourSwatch(SwatchColor=RGB(0, 0, 0))
move_2 = Move(Geometry=point, Motion=Z)  # -> Geometry, Transform
custom_preview = CustomPreview(Geometry=circle, Shader=colour_swatch)
vdisex = VectorDisplayEx(Point=move_2.Geometry, Vector=Z_2, Colour=colour_swatch, Width=Slider(5, range=0..10))

# ----
item_3 = ListItem(List=kohonen_map.Synaptics, Index=0, Wrap=True)  # -> Item, Item1, Item2, Item3, Item4
pt_2 = Point(kohonen_map.Locations)

# ---- group: Display the high-dimensional inputs with geometry, transformation, colour
# (display input)
ellipse = Ellipse(Plane=move.Geometry, Radius1=item_2.Item, Radius2=item_2.Item1)  # -> Ellipse, Focus1, Focus2
rotate = Rotate(Geometry=ellipse.Ellipse, Angle=item_2.Item2, Plane=move.Geometry)  # -> Geometry, Transform
rgb = ColourRGB(Alpha=255, Red=multiplication, Green=multiplication, Blue=multiplication)
preview = CustomPreview(Geometry=rotate.Geometry, Shader=rgb)

# ----
ellipse_2 = Ellipse(Plane=pt_2, Radius1=item_3.Item, Radius2=item_3.Item1)  # -> Ellipse, Focus1, Focus2
divide = DivideCurve(Curve=ellipse_2.Ellipse, Count=lng_2, Kinks=False)  # -> Points, Tangents, Parameters
rotate_2 = Rotate(Geometry=ellipse_2.Ellipse, Angle=item_3.Item2, Plane=kohonen_map.Locations)  # -> Geometry, Transform
vec2pt = Vector2Pt(PointA=pt_2, PointB=divide.Points, Unitize=False)  # -> unitize(Vector), Length
multiplication_2 = Multiplication(A=simplify(vec2pt.Vector), B=kohonen_map.Synaptics)
preview_2 = CustomPreview(
    Geometry=rotate_2.Geometry,
    Shader={ambient=RGB(0, 0, 0), diffuse=RGB(255, 105, 180), emission=RGB(76, 32, 54), shine=0.5, specular=RGB(255, 255, 255), transparency=0})
move_3 = Move(Geometry=pt_2, Motion=multiplication_2)  # -> Geometry, Transform
line = LineSDL(Start=simplify(pt_2), Direction=simplify(vec2pt.Vector), Length=kohonen_map.Synaptics)
pline = PolyLine(Vertices=move_3.Geometry, Closed=True)
