# Grasshopper definition Kohonen_example_003_mathfunction.gh (Grasshopper 0.9.76)
# plug-ins: KohonenMapper

# ---- group: 4 dimensions
number_slider = Slider(4, range=0..10)

# ---- group: a
number_slider_2 = Slider(0.17, range=0..1)

# ----
b = Slider(1, range=0..1)

# ---- group: c
number_slider_3 = Slider(0.17, range=0..1)

# ---- group: d
b_2 = Slider(1, range=0..1)

# ----
random = Random(Range=Domain(0, 1), Number=Slider(36, range=0..100), Seed=Slider(3, range=0..10))
cluster = Cluster(A=number_slider_2, A_3=b, A_4=number_slider_3, A_2=b_2)

# ---- group: Builds a data-tree of the inputs' feature vector
c_script = CSharpScript(x=random, y=number_slider)  # -> A; inputs x: list of Double, y: Int32
# ---------- c_script: C# ----------
    var tree = new DataTree<double>();
    GH_Path path;
    int legge = x.Count / y;
    int counter = 0;
    
    for (int i = 0; i < legge; i++)
    {
      path = new GH_Path(i);
      for (int j = 0; j < y; j++)
      {
        tree.Add(x[counter], path);
        counter++;
      }
    }

    A = tree;
# ---------- end c_script ----------

# ----
intcrv = Interpolate(Vertices=cluster, Degree=3, Periodic=True, KnotStyle=1)  # -> Curve, Length, Domain

# ---- group: ENABLE!
timer = Timer(TimerInterval=20, Target=kohonen_map)  # disabled

# ---- group: Location for displaying inputs
item = ListItem(List=c_script, Index=0, Wrap=True)
lng = ListLength(List=flatten(item))
series = Series(Start=0, Step="2.0", Count=lng)
pt = Point(Point(0.8259923995, -5.954375238, 0))
X = UnitX(Factor=series)
xy = XYPlane(Origin=pt)
move = Move(Geometry=xy, Motion=graft(X))  # -> Geometry, Transform

# ----
kohonen_map = KohonenMap(
    Reset=Toggle(False),
    XMap=Slider(20, range=0..100),
    YMap=Slider(15, range=0..100),
    Space=Slider(5, range=0..10),
    Inputs=c_script,
    WinLearn="0.98",
    Learn="0.95",
    WinLearnDecay=0.998,
    LearnDecay=0.9975,
    NeighDecay=0.99,
    NeighRad=Slider(0.5, range=0..1),
    Seed=Slider(21, range=0..100))  # -> Coverged, Counter, Locations, Synaptics, Neigh, InputLocations
item_2 = ListItem(List=c_script, Index=0, Wrap=True)  # -> Item, Item1, Item2, Item3
pt_2 = Point(kohonen_map.Locations)
pt_3 = Point(kohonen_map.Locations)
data = Data(kohonen_map.Synaptics)
data_2 = Data(kohonen_map.Synaptics)
multiplication = Multiplication(A=item_2.Item3, B="256")
item_3 = ListItem(List=data, Index=0, Wrap=True)  # -> Item, Item1, Item2, Item3; disabled

# ---- group: Display 'winning' node location
point = Point(kohonen_map.InputLocations)
circle = Circle(Plane=point, Radius=1)
Z = UnitZ(Factor="2.0")
Z_2 = UnitZ(Factor="-1.0")
colour_swatch = ColourSwatch(SwatchColor=RGB(0, 0, 0))
move_2 = Move(Geometry=point, Motion=Z)  # -> Geometry, Transform
custom_preview = CustomPreview(Geometry=circle, Shader=colour_swatch)
vdisex = VectorDisplayEx(Point=move_2.Geometry, Vector=Z_2, Colour=colour_swatch, Width=Slider(5, range=0..10))  # disabled

# ----
xy_2 = XYPlane(Origin=Point(0, 0, 0))

# ---- group: Display the high-dimensional inputs with geometry, transformation, colour
# (display input)
ellipse = Ellipse(Plane=move.Geometry, Radius1=item_2.Item, Radius2=item_2.Item1)  # -> Ellipse, Focus1, Focus2
rotate = Rotate(Geometry=ellipse.Ellipse, Angle=item_2.Item2, Plane=move.Geometry)  # -> Geometry, Transform
rgb = ColourRGB(Alpha=255, Red=multiplication, Green=multiplication, Blue=multiplication)
preview = CustomPreview(Geometry=rotate.Geometry, Shader=rgb)

# ----
cluster_2 = Cluster(A=item_3.Item, A_3=item_3.Item1, A_4=item_3.Item2, A_2=item_3.Item3)
vec2pt = Vector2Pt(PointA=xy_2, PointB=pt_2, Unitize=False)  # -> Vector, Length
intcrv_2 = Interpolate(Vertices=cluster_2, Degree=3, Periodic=True, KnotStyle=1)  # -> Curve, Length, Domain
move_3 = Move(Geometry=intcrv_2.Curve, Motion=vec2pt.Vector)  # -> Geometry, Transform
panel = Panel("""0
0""")  # disabled
path = ConstructPath(Indices=panel)  # disabled
branch = TreeBranch(Tree=data, Path=path, MaintainPaths=True)  # disabled
# (display output)
lng_2 = ListLength(List=flatten(branch))  # disabled
item_4 = ListItem(List=data, Index=0, Wrap=True)  # -> Item, Item1, Item2, Item3, Item4; disabled
ellipse_2 = Ellipse(Plane=pt_2, Radius1=item_4.Item, Radius2=item_4.Item1)  # -> Ellipse, Focus1, Focus2; disabled
divide = DivideCurve(Curve=ellipse_2.Ellipse, Count=lng_2, Kinks=False)  # -> Points, Tangents, Parameters; disabled
rotate_2 = Rotate(Geometry=ellipse_2.Ellipse, Angle=item_4.Item2, Plane=pt_2)  # -> Geometry, Transform; disabled
vec2pt_2 = Vector2Pt(PointA=pt_2, PointB=divide.Points, Unitize=False)  # -> unitize(Vector), Length; disabled
multiplication_2 = Multiplication(A=simplify(vec2pt_2.Vector), B=data)  # disabled
preview_2 = CustomPreview(
    Geometry=rotate_2.Geometry,
    Shader={ambient=RGB(0, 0, 0), diffuse=RGB(255, 105, 180), emission=RGB(76, 32, 54), shine=0.5, specular=RGB(255, 255, 255), transparency=0})  # disabled
move_4 = Move(Geometry=pt_2, Motion=multiplication_2)  # -> Geometry, Transform; disabled
line = LineSDL(Start=simplify(pt_2), Direction=simplify(vec2pt_2.Vector), Length=data)  # disabled
pline = PolyLine(Vertices=move_4.Geometry, Closed=True)  # disabled

# ==== cluster Cluster
number_slider = Slider(300, range=0..1000)
pi = Pi(Factor=Slider(2, range=0..10))
division = Division(A=pi, B=number_slider)
A = ClusterInput()
series = Series(Start=0, Step=division, Count=number_slider)
A_2 = ClusterInput()
A_3 = ClusterInput()
A_4 = ClusterInput()
multiplication = Multiplication(A=A, B="6")
multiplication_2 = Multiplication(A=A_2, B="6")
multiplication_3 = Multiplication(A=A_3, B="6")
multiplication_4 = Multiplication(A=A_4, B="6")
multiplication_5 = Multiplication(A=series, B=multiplication)
j = Slider(3, range=0..10)
multiplication_6 = Multiplication(A=series, B=multiplication_4)

# ---- group: k
j_2 = Slider(3, range=0..10)

# ----
multiplication_7 = Multiplication(A=series, B=multiplication_3)
multiplication_8 = Multiplication(A=series, B=multiplication_2)
sin = Sine(Value=multiplication_6)
cos = Cosine(Value=multiplication_7)
sin_2 = Sine(Value=multiplication_8)
cos_2 = Cosine(Value=multiplication_5)
cos_3 = Cosine(Value=multiplication_6)
pow = Power(A=cos, B=j)
pow_2 = Power(A=sin_2, B=j_2)
subtraction = Subtraction(A=sin, B=pow_2)
subtraction_2 = Subtraction(A=cos_2, B=pow)
pt = ConstructPoint(XCoordinate=subtraction_2, YCoordinate=subtraction, ZCoordinate=0)
pt_2 = ClusterOutput(pt)
