# Grasshopper definition Kohonen_example_003_temp2.gh (Grasshopper 0.9.76)
# plug-ins: KohonenMapper

# Input parameters
number_slider = Slider(35, range=0..100)

# ---- group: 5 dimensions
number_slider_2 = Slider(5, range=0..10)

# ----
random = Random(Range=Domain(0, 1), Number=number_slider, Seed=Slider(3, range=0..10))

# ---- group: Builds a data-tree of the inputs' feature vector
c_script = CSharpScript(x=random, y=number_slider_2)  # -> A; inputs x: list of Double, y: Int32
# ---------- c_script: C# ----------
    var tree = new DataTree<double>();
    GH_Path path;
    int legge = x.Count / y;
    int counter = 0;
    
    for (int i = 0; i < legge; i++)
    {
      path = new GH_Path(i);
      for (int j = 0; j < y; j++)
      {
        tree.Add(x[counter], path);
        counter++;
      }
    }

    A = tree;
# ---------- end c_script ----------

# ----
panel = Panel(c_script)
# SOM Component
timer = Timer(TimerInterval=20, Target=kohonen_map)  # disabled
kohonen_map = KohonenMap(
    Reset=Toggle(False),
    XMap=Slider(7, range=0..100),
    YMap=Slider(7, range=0..100),
    Space=Slider(2, range=0..10),
    Inputs=c_script,
    WinLearn="0.98",
    Learn="0.95",
    WinLearnDecay=0.998,
    LearnDecay=0.9975,
    NeighDecay=0.99,
    NeighRad=Slider(0.5, range=0..1),
    Seed=Slider(25, range=0..100))  # -> Coverged, Counter, Locations, Synaptics, Neigh, InputLocations
panel_2 = Panel("""0
0""")
pt = Point(kohonen_map.Locations)
item = ListItem(List=kohonen_map.Synaptics, Index=0, Wrap=True)  # -> Item, Item1, Item2, Item3, Item4
path = ConstructPath(Indices=panel_2)
# (display input locations on map)
circle = Circle(Plane=kohonen_map.InputLocations, Radius=1)
# (display map)
branch = TreeBranch(Tree=kohonen_map.Synaptics, Path=path, MaintainPaths=True)
lng = ListLength(List=flatten(branch))
ellipse = Ellipse(Plane=pt, Radius1=item.Item, Radius2=item.Item1)  # -> Ellipse, Focus1, Focus2
custom_preview = CustomPreview(Geometry=circle, Shader=ColourSwatch(SwatchColor=RGB(0, 0, 0)))
divide = DivideCurve(Curve=ellipse.Ellipse, Count=lng, Kinks=False)  # -> Points, Tangents, Parameters
vec2pt = Vector2Pt(PointA=pt, PointB=divide.Points, Unitize=False)  # -> unitize(Vector), Length
multiplication = Multiplication(A=simplify(vec2pt.Vector), B=kohonen_map.Synaptics)
# (glyph geometry)
move = Move(Geometry=pt, Motion=multiplication)  # -> Geometry, Transform
line = LineSDL(Start=simplify(pt), Direction=simplify(vec2pt.Vector), Length=kohonen_map.Synaptics)
pline = PolyLine(Vertices=move.Geometry, Closed=True)
