# Grasshopper definition Kohonen_example_003_tower_2.gh (Grasshopper 0.9.76)
# plug-ins: KohonenMapper

number_slider = Slider(35, range=0..100)

# ---- group: 4 dimensions
number_slider_2 = Slider(5, range=0..10)

# ----
number_slider_3 = Slider(70, range=0..100)
number_slider_4 = Slider(1, range=0..1)
number_slider_5 = Slider(1, range=0..1)
number_slider_6 = Slider(1, range=0..1)
random = Random(Range=Domain(0, 1), Number=Slider(45, range=0..100), Seed=Slider(3, range=0..10))
number_slider_7 = Slider(0.6, range=0..1)
panel = Panel("0.5")

# ---- group: Builds a data-tree of the inputs' feature vector
c_script = CSharpScript(x=random, y=number_slider_2)  # -> A; inputs x: list of Double, y: Int32
# ---------- c_script: C# ----------
    var tree = new DataTree<double>();
    GH_Path path;
    int legge = x.Count / y;
    int counter = 0;
    
    for (int i = 0; i < legge; i++)
    {
      path = new GH_Path(i);
      for (int j = 0; j < y; j++)
      {
        tree.Add(x[counter], path);
        counter++;
      }
    }

    A = tree;
# ---------- end c_script ----------

# ----
num = Number(Slider(1, range=0..1))
multiplication = Multiplication(A=num, B="0.25")
neg = Negative(Value=multiplication)
dom = ConstructDomain(DomainStart=multiplication, DomainEnd=neg)
panel_2 = Panel("0.98")
panel_3 = Panel("0.95")
number_slider_8 = Slider(0, range=0..100)

# ---- group: ENABLE!
timer = Timer(TimerInterval=20, Target=kohonen_map)  # disabled

# ---- group: Check datastructure
panel_4 = Panel(c_script)

# ---- group: Location for displaying inputs
item = ListItem(List=c_script, Index=0, Wrap=True)
lng = ListLength(List=flatten(item))
series = Series(Start=0, Step="2.0", Count=lng)
pt = Point(Point(0.8259923995, -5.954375238, 0))
X = UnitX(Factor=series)
xy = XYPlane(Origin=pt)
move = Move(Geometry=xy, Motion=graft(X))  # -> Geometry, Transform

# ----
kohonen_map = KohonenMap(
    Reset=Toggle(False),
    XMap=Slider(20, range=0..100),
    YMap=Slider(15, range=0..100),
    Space=Slider(2, range=0..10),
    Inputs=c_script,
    WinLearn=number_slider_8,
    Learn=number_slider_8,
    WinLearnDecay=0.998,
    LearnDecay=0.9975,
    NeighDecay=0.99,
    NeighRad=Slider(0.5, range=0..1),
    Seed=Slider(28, range=0..100))  # -> Coverged, Counter, Locations, Synaptics, Neigh, InputLocations
item_2 = ListItem(List=c_script, Index=0, Wrap=True)  # -> Item, Item1, Item2, Item3
pt_2 = Point(kohonen_map.Locations)
xy_2 = XYPlane(Origin=pt_2)
data = Data(kohonen_map.Synaptics)
item_3 = ListItem(List=data, Index=0, Wrap=True)  # -> Item, Item1, Item2, Item3, Item4
num_2 = Number(item_3.Item)
num_3 = Number(item_3.Item1)
num_4 = Number(item_3.Item2)
num_5 = Number(item_3.Item4)
pi = Pi(Factor=item_3.Item3)
multiplication_2 = Multiplication(A=num_2, B="0.35")
multiplication_3 = Multiplication(A=num_3, B="4")
multiplication_4 = Multiplication(A=num_4, B=pi)
neg_2 = Negative(Value=multiplication_2)
addition = Addition(A=multiplication_3, B="0.1")
dom_2 = ConstructDomain(DomainStart=multiplication_2, DomainEnd=neg_2)
Z = UnitZ(Factor=addition)
rectangle = Rectangle(Plane=xy_2, XSize=dom, YSize=dom_2, Radius=0)  # -> Rectangle, Length
pt_3 = Point(kohonen_map.Locations)
data_2 = Data(kohonen_map.Synaptics)
move_2 = Move(Geometry=rectangle.Rectangle, Motion=Z)  # -> Geometry, Transform
multiplication_5 = Multiplication(A=item_2.Item3, B="256")

# ---- group: Display 'winning' node location
point = Point(kohonen_map.InputLocations)
circle = Circle(Plane=point, Radius=1)
Z_2 = UnitZ(Factor="2.0")
Z_3 = UnitZ(Factor="-1.0")
colour_swatch = ColourSwatch(SwatchColor=RGB(0, 0, 0))
move_3 = Move(Geometry=point, Motion=Z_2)  # -> Geometry, Transform
custom_preview = CustomPreview(Geometry=circle, Shader=colour_swatch)
vdisex = VectorDisplayEx(Point=move_3.Geometry, Vector=Z_3, Colour=colour_swatch, Width=Slider(5, range=0..10))  # disabled

# ----
rotate = Rotate(Geometry=move_2.Geometry, Angle=multiplication_4, Plane=xy_2)  # -> Geometry, Transform
pcen = PolygonCenter(Polyline=rectangle.Rectangle)  # -> CenterV, CenterE, CenterA
multiplication_6 = Multiplication(A=num_5, B="3")

# ---- group: Display the high-dimensional inputs with geometry, transformation, colour
# (display input)
ellipse = Ellipse(Plane=move.Geometry, Radius1=item_2.Item, Radius2=item_2.Item1)  # -> Ellipse, Focus1, Focus2
rotate_2 = Rotate(Geometry=ellipse.Ellipse, Angle=item_2.Item2, Plane=move.Geometry)  # -> Geometry, Transform
rgb = ColourRGB(Alpha=255, Red=multiplication_5, Green=multiplication_5, Blue=multiplication_5)
preview = CustomPreview(Geometry=rotate_2.Geometry, Shader=rgb)

# ----
scale = Scale(Geometry=rectangle.Rectangle, Center=pcen.CenterV, Factor=multiplication_6)  # -> Geometry, Transform
number_slider_9 = Slider(0.96, range=0..1)
merge = Merge(Data1=scale.Geometry, Data2=rotate.Geometry)
panel_5 = Panel("""0
0""")  # disabled
path = ConstructPath(Indices=panel_5)  # disabled
loft = Loft(Curves=merge, Options={Adjust=False, Closed=False, LoftEnds=0, LoftSimp=0, LoftType=0, Rebuild=10, Refit=0.01})
branch = TreeBranch(Tree=data_2, Path=path, MaintainPaths=True)  # disabled
scale_nu = ScaleNU(Geometry=loft, Plane=xy_2, ScaleX=number_slider_9, ScaleY=number_slider_9, ScaleZ=1)  # -> Geometry, Transform
# (display output)
lng_2 = ListLength(List=flatten(branch))  # disabled
item_4 = ListItem(List=data_2, Index=0, Wrap=True)  # -> Item, Item1, Item2, Item3, Item4; disabled
cap = CapHoles(Brep=scale_nu.Geometry)
ellipse_2 = Ellipse(Plane=pt_3, Radius1=item_4.Item, Radius2=item_4.Item1)  # -> Ellipse, Focus1, Focus2; disabled
series_2 = Series(Start=0, Step="0.1", Count=10)
series_3 = Series(Start=0, Step="0.1", Count=10)
series_4 = Series(Start=0, Step="0.1", Count=10)
divide = DivideCurve(Curve=ellipse_2.Ellipse, Count=lng_2, Kinks=False)  # -> Points, Tangents, Parameters; disabled
crossref = CrossReference(ListA=series_2, ListB=series_3, ListC=series_4, CrossMode=1)  # -> ListA, ListB, ListC
rotate_3 = Rotate(Geometry=ellipse_2.Ellipse, Angle=item_4.Item2, Plane=pt_3)  # -> Geometry, Transform; disabled
vec2pt = Vector2Pt(PointA=pt_3, PointB=divide.Points, Unitize=False)  # -> unitize(Vector), Length; disabled
pt_4 = ConstructPoint(XCoordinate=crossref.ListA, YCoordinate=crossref.ListB, ZCoordinate=crossref.ListC)
multiplication_7 = Multiplication(A=simplify(vec2pt.Vector), B=data_2)  # disabled
scale_2 = Scale(Geometry=pt_4, Center=Point(0, 0, 0), Factor=Slider(49, range=0..100))  # -> Geometry, Transform
preview_2 = CustomPreview(
    Geometry=rotate_3.Geometry,
    Shader={ambient=RGB(0, 0, 0), diffuse=RGB(255, 105, 180), emission=RGB(76, 32, 54), shine=0.5, specular=RGB(255, 255, 255), transparency=0})  # disabled
move_4 = Move(Geometry=pt_3, Motion=multiplication_7)  # -> Geometry, Transform; disabled
line = LineSDL(Start=simplify(pt_3), Direction=simplify(vec2pt.Vector), Length=data_2)  # disabled
pline = PolyLine(Vertices=move_4.Geometry, Closed=True)  # disabled
