# Grasshopper definition Kohonen_example_002.gh (Grasshopper 0.9.76)
# plug-ins: KohonenMapper

number_slider = Slider(12, range=0..100)
random = Random(Range=Domain(0, 1), Number=Slider(24, range=0..100), Seed=Slider(3, range=0..10))
c_script = CSharpScript(x=random, y=Slider(3, range=0..10))  # -> A; inputs x: list of Double, y: Int32
# ---------- c_script: C# ----------
    var tree = new DataTree<double>();
    GH_Path path;
    int legge = x.Count / y;
    int counter = 0;
    
    for (int i = 0; i < legge; i++)
    {
      path = new GH_Path(i);
      for (int j = 0; j < y; j++)
      {
        tree.Add(x[counter], path);
        counter++;
      }
    }

    A = tree;
# ---------- end c_script ----------
item = ListItem(List=c_script, Index=0, Wrap=True)
panel = Panel(c_script)
timer = Timer(TimerInterval=20, Target=kohonen_map)
lng = ListLength(List=flatten(item))
kohonen_map = KohonenMap(
    Reset=Toggle(True),
    XMap=Slider(25, range=0..100),
    YMap=Slider(17, range=0..100),
    Space=Slider(2, range=0..10),
    Inputs=c_script,
    WinLearn="0.95",
    Learn="0.9")  # -> Coverged, Counter, Locations, Synaptics, Me, InputLocations
pt = Point(Point(0.8259923995, -5.954375238, 0))
series = Series(Start=0, Step="2.0", Count=lng)
X = UnitX(Factor=series)
xy = XYPlane(Origin=pt)
move = Move(Geometry=xy, Motion=X)  # -> Geometry, Transform
cluster = Cluster_2(B=graft(move.Geometry), data=c_script)  # -> B_2, C
preview = CustomPreview(Geometry=cluster.B_2, Shader=cluster.C)

# ---- group: Display input location
Z = UnitZ(Factor="2.0")
Z_2 = UnitZ(Factor="-1.0")
move_2 = Move(Geometry=kohonen_map.InputLocations, Motion=Z)  # -> Geometry, Transform
vdisex = VectorDisplayEx(Point=move_2.Geometry, Vector=Z_2, Colour=ColourSwatch(SwatchColor=RGB(255, 255, 255)), Width=Slider(5, range=0..10))

# ----
cluster_2 = Cluster(B=kohonen_map.Locations, data=kohonen_map.Synaptics)  # -> B_2, C
preview_2 = CustomPreview(Geometry=cluster_2.B_2, Shader=cluster_2.C)

# ==== cluster Cluster
B = ClusterInput()
data = ClusterInput()
data_2 = Data(data)
item = ListItem(List=data_2, Index=0, Wrap=True)
item_2 = ListItem(List=data_2, Index=1, Wrap=True)
item_3 = ListItem(List=data_2, Index=2, Wrap=True)
frgb = ColourRGBF(Alpha=1, Red=item, Green=item_2, Blue=item_3)
C = ClusterOutput(frgb)
box = CenterBox(Base=B, X=item, Y=item_2, Z=item_3)
B_2 = ClusterOutput(box)

# ==== cluster Cluster_2
data = ClusterInput()
data_2 = Data(data)
item = ListItem(List=data_2, Index=0, Wrap=True)
item_2 = ListItem(List=data_2, Index=1, Wrap=True)
item_3 = ListItem(List=data_2, Index=2, Wrap=True)
B = ClusterInput()
frgb = ColourRGBF(Alpha=1, Red=item, Green=item_2, Blue=item_3)
box = CenterBox(Base=B, X=item, Y=item_2, Z=item_3)
C = ClusterOutput(frgb)
B_2 = ClusterOutput(box)
