# Grasshopper definition Kohonen_example_007.gh (Grasshopper 0.9.76)
# plug-ins: KohonenMapper

number_slider = Slider(12, range=0..100)
number_slider_2 = Slider(6, range=0..10)
random = Random(Range=Domain(0, 1), Number=Slider(36, range=0..100), Seed=Slider(7, range=0..10))
c_script = CSharpScript(x=random, y=number_slider_2)  # -> A; inputs x: list of Double, y: Int32
# ---------- c_script: C# ----------
    var tree = new DataTree<double>();
    GH_Path path;
    int legge = x.Count / y;
    int counter = 0;
    
    for (int i = 0; i < legge; i++)
    {
      path = new GH_Path(i);
      for (int j = 0; j < y; j++)
      {
        tree.Add(x[counter], path);
        counter++;
      }
    }

    A = tree;
# ---------- end c_script ----------
item = ListItem(List=c_script, Index=0, Wrap=True)
lng = ListLength(List=flatten(item))
timer = Timer(TimerInterval=20, Target=kohonen_map)  # disabled
kohonen_map = KohonenMap(
    Reset=Toggle(False),
    XMap=Slider(50, range=0..100),
    YMap=Slider(30, range=0..100),
    Space=Slider(1, range=0..10),
    Inputs=c_script,
    WinLearn="0.95",
    Learn="0.9")  # -> Coverged, Counter, Locations, Synaptics, Me, InputLocations
pt = Point(Point(0.8259923995, -5.954375238, 0))
series = Series(Start=0, Step="2.0", Count=lng)
X = UnitX(Factor=series)
xy = XYPlane(Origin=pt)
move = Move(Geometry=xy, Motion=graft(X))  # -> Geometry, Transform
int = Integer(number_slider_2)
pi = Pi(Factor=Slider(2, range=0..10))
division = Division(A=pi, B=int)
series_2 = Series(Start=0, Step=division, Count=int)
pt_2 = PointPolar(BasePlane=kohonen_map.Locations, XYAngle=series_2, ZAngle=0, Offset=kohonen_map.Synaptics)
ln = Line(StartPoint=kohonen_map.Locations, EndPoint=pt_2)  # disabled

# ---- group: Display input location
Z = UnitZ(Factor="2.0")
Z_2 = UnitZ(Factor="-1.0")
move_2 = Move(Geometry=kohonen_map.InputLocations, Motion=Z)  # -> Geometry, Transform
vdisex = VectorDisplayEx(Point=move_2.Geometry, Vector=Z_2, Colour=ColourSwatch(SwatchColor=RGB(0, 0, 0)), Width=Slider(5, range=0..10))

# ----
nurbs = NurbsCurve(Vertices=pt_2, Degree=3, Periodic=True)  # -> Curve, Length, Domain; disabled
pline = PolyLine(Vertices=pt_2, Closed=True)
preview = CustomPreview(Geometry=pline, Shader=ColourSwatch(SwatchColor=RGB(0, 0, 0)))
