# Grasshopper definition Kohonen_example_008_Froebel.gh (Grasshopper 0.9.76)
# plug-ins: KohonenMapper

number_slider = Slider(6, range=0..10)
random = Random(Range=Domain(0, 1), Number=Slider(36, range=0..100), Seed=Slider(7, range=0..10))
c_script = CSharpScript(x=random, y=number_slider)  # -> A; inputs x: list of Double, y: Int32
# ---------- c_script: C# ----------
    var tree = new DataTree<double>();
    GH_Path path;
    int legge = x.Count / y;
    int counter = 0;
    
    for (int i = 0; i < legge; i++)
    {
      path = new GH_Path(i);
      for (int j = 0; j < y; j++)
      {
        tree.Add(x[counter], path);
        counter++;
      }
    }

    A = tree;
# ---------- end c_script ----------
toggle = BooleanToggle(True)
item = ListItem(List=c_script, Index=0, Wrap=True)
not = GateNot(A=Slider(200, range=0..200))
lng = ListLength(List=flatten(item))
timer = Timer(TimerInterval=20, Target=kohonen_map)  # disabled
kohonen_map = KohonenMap(
    Reset=not,
    XMap=Slider(25, range=0..100),
    YMap=Slider(15, range=0..100),
    Space=Slider(100, range=0..100),
    Inputs=c_script,
    WinLearn="0.95",
    Learn="0.9")  # -> Coverged, Counter, Locations, Synaptics, Me, InputLocations
pt = Point(Point(0.8259923995, -5.954375238, 0))
series = Series(Start=0, Step="2.0", Count=lng)
X = UnitX(Factor=series)
xy = XYPlane(Origin=pt)
move = Move(Geometry=xy, Motion=graft(X))  # -> Geometry, Transform
int = Integer(number_slider)
item_2 = ListItem(List=kohonen_map.Synaptics, Index=0, Wrap=True)  # -> Item, Item1, Item2, Item3, Item4, Item5
pi = Pi(Factor=Slider(2, range=0..10))
division = Division(A=pi, B=int)
xy_2 = XYPlane(Origin=kohonen_map.Locations)
swatch = ColourSwatch(SwatchColor=RGB(0, 0, 0))

# ---- group: Display input location
Z = UnitZ(Factor="2.0")
Z_2 = UnitZ(Factor="-1.0")
move_2 = Move(Geometry=kohonen_map.InputLocations, Motion=Z)  # -> Geometry, Transform
vdisex = VectorDisplayEx(Point=move_2.Geometry, Vector=Z_2, Colour=ColourSwatch(SwatchColor=RGB(0, 0, 0)), Width=Slider(5, range=0..10))

# ----
cluster = Cluster(
    O=xy_2,
    num_6=expr("x*2", item_2.Item),
    num_3=expr("x*2", item_2.Item1),
    num_4=expr("x*2", item_2.Item2),
    num_5=expr("x*2", item_2.Item3),
    num_2=expr("x*2", item_2.Item4),
    num=expr("x*2", item_2.Item5))
series_2 = Series(Start=0, Step=division, Count=int)
pt_2 = PointPolar(BasePlane=kohonen_map.Locations, XYAngle=series_2, ZAngle=0, Offset=kohonen_map.Synaptics)
ln = Line(StartPoint=kohonen_map.Locations, EndPoint=pt_2)  # disabled
nurbs = NurbsCurve(Vertices=pt_2, Degree=3, Periodic=True)  # -> Curve, Length, Domain; disabled
preview = CustomPreview(Geometry=cluster, Shader=ColourSwatch(SwatchColor=RGB(0, 0, 0)))
pline = PolyLine(Vertices=pt_2, Closed=True)
preview_2 = CustomPreview(Geometry=pline, Shader=ColourSwatch(SwatchColor=RGB(0, 0, 0)))

# ==== cluster Cluster
num = ClusterInput()
num_2 = ClusterInput()
num_3 = ClusterInput()
num_4 = ClusterInput()
num_5 = ClusterInput()
num_6 = ClusterInput()
num_7 = Number(num)
num_8 = Number(num_2)
num_9 = Number(num_3)
num_10 = Number(num_4)
num_11 = Number(num_5)
num_12 = Number(num_6)
O = ClusterInput()
xy = XYPlane(Origin=O)
number_slider = Slider(3, range=0..10)
block2 = Block2(InPlane=xy, InLength=expr("x*2", num_9), AddStoreys=expr("x*5", num_12))  # -> OutBox, OutPlane1, OutPlane2, OutPlane3, OutPoint1
block1 = Block1(InPlane=block2.OutPlane3, InLength=expr("x*2", num_11))  # -> OutBox, OutPlane1, OutPlane2
block1_2 = Block1(InPlane=block2.OutPlane1, InLength=expr("x*2", num_10))  # -> OutBox, OutPlane1, OutPlane2
block1_3 = Block1(InPlane=block1_2.OutPlane2, InLength=expr("x*2", num_7))  # -> OutBox, OutPlane1, OutPlane2
block1_4 = Block1(InPlane=block1.OutPlane1, InLength=expr("x*1.9", num_8))  # -> OutBox, OutPlane1, OutPlane2
link2 = Link2(InPoint1=block1_4.OutPlane1, InPoint2=block1_3.OutPlane2)
geo = Geometry([block1_2.OutBox, link2, block1_4.OutBox, block1_3.OutBox, block1.OutBox, block2.OutBox])
geo_2 = ClusterOutput(geo)
